# Dynamo graph 桩基础.dyn (Dynamo 2.1.0.7500)

categories = Categories("OST_StructuralFoundation")
all_elements_of_category = ElementsOfCategory(Category=categories)
parameters = Element.Parameters(element=all_elements_of_category)
id = Parameter.Id(parameter=parameters)
code_block = CodeBlock { -1002051; }
eq = id == code_block
filterByBoolMask = List.FilterByBoolMask(list=parameters, mask=eq)
value = Parameter.Value(parameter=filterByBoolMask.in)
family = FamilyType.Family(familyType=value)
name = Family.Name(family=family)
code_block_2 = CodeBlock { "桩"; }
contains = String.Contains(str=name, searchFor=code_block_2)
flatten = List.Flatten(list=contains)
filterByBoolMask_2 = List.FilterByBoolMask(list=all_elements_of_category, mask=flatten)
getLocation = Element.GetLocation(element=filterByBoolMask_2.in)
select_model_element = DSModelElementSelection()  # 1 picked in the model
mesh = Topography.Mesh(topography=select_model_element)
python_script = Python(IN[0]=mesh)
# ---------- python_script.python (53 lines) ----------
import clr
from System.Threading import Thread, ThreadStart

clr.AddReference('ProtoGeometry')
from Autodesk.DesignScript.Geometry import *

def tolist(obj1):
	if hasattr(obj1,'__iter__'): return obj1
	else: return [obj1]

def output1(l1):
	if len(l1) == 1: return l1[0]
	else: return l1

def chop1(l1, n):
	return [l1[x:x+n] for x in xrange(0, len(l1), n)]

def mesh2ps(topo, f_chop = chop1,
			f_ps1 = PolySurface.ByJoinedSurfaces):
	vp = topo.VertexPositions
	fi = topo.FaceIndices
	xr1 = xrange(len(fi) )
	ind = [(fi[i].A, fi[i].B, fi[i].C) for i in xr1]
	ptslist = [ map(vp.__getitem__, ind[i]) for i in xr1]
	len1 = int(round(len(ptslist) ) ) / 4 + 1
	ptslist = f_chop(ptslist, len1)
	surf = [None, None, None, None]

	def ps_generator(i, f_chop = chop1,
					 f_ps1 = PolySurface.ByJoinedSurfaces,
					 f_sf1 = Surface.ByPerimeterPoints):
		sflist = [f_sf1(pts) for pts in ptslist[i] ]
		while len(sflist) > 10 :
			sflist = f_chop(sflist,10)
			sflist = [f_ps1(sf1) for sf1 in sflist]
		surf[i] = sflist
		return

	def threaded_ps0(): return ps_generator(0)
	def threaded_ps1(): return ps_generator(1)
	def threaded_ps2(): return ps_generator(2)
	def threaded_ps3(): return ps_generator(3)
	threads = (Thread(ThreadStart(threaded_ps0) ),
			   Thread(ThreadStart(threaded_ps1) ),
			   Thread(ThreadStart(threaded_ps2) ),
			   Thread(ThreadStart(threaded_ps3) ) )
	for t in threads: t.Start()
	for t in threads: t.Join()
	return f_ps1(surf[0] + surf[1] + surf[2] + surf[3])
	for t in threads: t.Finalize()

meshes = tolist(IN[0])
OUT = output1(map(mesh2ps,meshes) )
# ----------------------------------------
ZAxis = Vector.ZAxis()
reverse = Vector.Reverse(vector=ZAxis)
project = Point.Project(point=getLocation, baseGeometry=python_script, projectionDirection=reverse)
code_block_3 = CodeBlock(startP=getLocation, endP=project) { startP.Z-endP.Z+500; "桩长度"; }
setParameterByName = Element.SetParameterByName(element=filterByBoolMask_2.in, parameterName=code_block_3.out1, value=code_block_3.out0)
watch = Watch(code_block_3.out0)
