# Dynamo graph 钢结构杆件.dyn (Dynamo 2.1.0.7500)

categories = Categories("OST_GenericModel")
all_elements_of_category = ElementsOfCategory(Category=categories)
locations = AdaptiveComponent.Locations(adaptiveComponent=all_elements_of_category)
count = List.Count(list=locations@L2)
groupByKey = List.GroupByKey(list=all_elements_of_category, keys=count)
code_block = CodeBlock(list=groupByKey.groups) { list[0]; list[1]; }
code_block_2 = CodeBlock { "ExcessLength"; }
watch = Watch(code_block.out0)
locations_2 = AdaptiveComponent.Locations(adaptiveComponent=code_block.out1)
flatten = List.Flatten(list=locations_2)
locations_3 = AdaptiveComponent.Locations(adaptiveComponent=watch)
flatten_2 = List.Flatten(list=locations_3)
isAlmostEqualTo = Geometry.IsAlmostEqualTo(geometry=flatten, other=flatten_2, lacing=CrossProduct)
filterByBoolMask = List.FilterByBoolMask(list=watch, mask=isAlmostEqualTo@L2)
watch_2 = Watch(filterByBoolMask.in)
flatten_3 = List.Flatten(list=watch_2)
code_block_3 = CodeBlock { 2; }
chop = List.Chop(list=flatten_3, lengths=code_block_3)
code_block_4 = CodeBlock { "Radius"; }
getParameterValueByName = Element.GetParameterValueByName(element=chop, parameterName=code_block_4)
transpose = List.Transpose(lists=getParameterValueByName)
code_block_5 = CodeBlock(list=transpose) { list[0]; list[1]; }
add = code_block_5.out0 + code_block_5.out1
setParameterByName = Element.SetParameterByName(element=code_block.out1, parameterName=code_block_2, value=add)
